# Grasshopper definition 1ex_xr_assembly_firebase.ghx (Grasshopper 1.0.7)

bang = Button()
panel = Panel("Unload libraries")
unload = PythonScript(bang=bang)
# ---------- unload: Python ----------
from compas_rhino.utilities.misc import get_tolerance
from compas_rhino.utilities.misc import unload_modules

unload_modules("compas")
unload_modules("assembly_information_model")
unload_modules("xr_assembly")
# ---------- end unload ----------

# ----
# Import Assembly data from JSON
py = PythonScript()  # -> DATA
# ---------- py: Python ----------
import os
import getpass

username = getpass.getuser()
USER_FOLDER = os.path.abspath(os.path.join("C:/Users/", username))
DATA = os.path.abspath(os.path.join(USER_FOLDER,"workspace/projects/xr_assembly/data"))

print(username)
print(USER_FOLDER)
print(DATA)
# ---------- end py ----------
import = PythonScript(DATA=py, filename="xrtest.json", import_from_json=Toggle(True))  # -> assembly
# ---------- import: Python ----------
import os
from xr_assembly.assembly.assembly import XRAssembly


if import_from_json:
    #filename = "my_assembly.json"
    PATH = os.path.join(DATA, filename)
    assembly = XRAssembly.from_json(PATH)
# ---------- end import ----------

# ----
# Draw
idx = Slider(19, range=0..40)
show = BooleanToggle(False)
show_2 = BooleanToggle(True)
show_3 = BooleanToggle(False)
show_4 = BooleanToggle(False)
# Firebase
show_5 = BooleanToggle(False)
draw = PythonScript(
    assembly=import,
    show_all=show_2,
    show_network=show_3,
    show_built=show,
    show_buildable=show_4,
    idx_selected=idx,
    show_selected=show_5)  # -> G_elements_all, G_elements_structure, G_elements_support, G_nodes, G_edges, G_elements_built, G_elements_buildable, G_element_selected, planes, all_keys; inputs idx_selected: Int32, show_selected: Boolean
# ---------- draw: Python ----------
import os
import sys

import math
import rhinoscriptsyntax as rs
import Rhino.Geometry as rg
import ghpythonlib as gh

from compas.geometry import Vector
from compas_ghpython.artists import MeshArtist
from compas_ghpython.artists import NetworkArtist
from compas_ghpython import draw_frame

G_elements_all = []
G_elements_structure = []
G_elements_built = []
G_elements_buildable = []
G_element_selected = []
planes = []

print(assembly)

if show_all:
    for key, element in assembly.elements():
        artist = MeshArtist(element.mesh)
        mesh = artist.draw()
        G_elements_all.append(mesh)
        
    # elements which are part of the structure
    keys_support = list(assembly.network.nodes_where({'is_support':False}))
    for key in keys_support:
        element = assembly.element(key)
        artist = MeshArtist(element.mesh)
        mesh = artist.draw()
        G_elements_structure.append(mesh)
        planes.append(draw_frame(element.frame))

if show_network:
    G_nodes, G_edges = NetworkArtist(assembly.network).draw()

if show_built:
    keys = list(assembly.network.nodes_where({'is_built':True}))
    for key in keys:
        element = assembly.element(key)
        artist = MeshArtist(element.mesh)
        mesh = artist.draw()
        G_elements_built.append(mesh)

if show_buildable:
    keys = assembly.get_keys_buildable()
    for key in keys:
        element = assembly.element(key)
        artist = MeshArtist(element.mesh)
        mesh = artist.draw()
        G_elements_buildable.append(mesh)

if show_selected:
    element = assembly.element(idx_selected)
    artist = MeshArtist(element.mesh)
    mesh = artist.draw()
    G_element_selected=mesh

all_keys = []

for key, element in assembly.elements():
    all_keys.append(key)
# ---------- end draw ----------
pt = Point(draw.G_nodes)
pln = Plane(draw.planes)
mesh = Mesh(draw.G_elements_all)
mesh_2 = Mesh(draw.G_elements_structure)
mesh_3 = Mesh(draw.G_elements_support)
line = Line(draw.G_edges)
mesh_4 = Mesh(draw.G_elements_built)
mesh_5 = Mesh(draw.G_elements_buildable)
mesh_6 = Mesh(draw.G_element_selected)
preview = CustomPreview(Geometry=mesh, Shader=ColourSwatch(SwatchColor=RGBA(209, 163, 163, 40)))
preview_2 = CustomPreview(Geometry=mesh_2, Shader=ColourSwatch(SwatchColor=RGBA(255, 156, 156, 111)))
preview_3 = CustomPreview(Geometry=mesh_3, Shader=ColourSwatch(SwatchColor=RGBA(156, 156, 156, 0)))
preview_4 = CustomPreview(Geometry=mesh_4, Shader=ColourSwatch(SwatchColor=RGB(209, 105, 105)))
preview_5 = CustomPreview(Geometry=mesh_5, Shader=ColourSwatch(SwatchColor=RGBA(168, 163, 209, 102)))
preview_6 = CustomPreview(Geometry=mesh_6, Shader=ColourSwatch(SwatchColor=RGB(255, 99, 99)))
preview_7 = CustomPreview(Geometry=pt, Shader=ColourSwatch(SwatchColor=RGB(0, 0, 0)))
preview_8 = CustomPreview(Geometry=line, Shader=ColourSwatch(SwatchColor=RGB(255, 122, 122)))
tag = TextTag(Location=draw.G_nodes, Text=draw.all_keys)

# ----
# write to realtime database
panel_2 = Panel("""5
10
12
13""")
key = Slider(5, range=0..100)
remove = Button()
connect = BooleanToggle(False)
add = Button()
set = Button()
write = GhPythonScript(key=key, keys=panel_2, set_keys=set, add_key=add, remove_key=remove, connect=connect)  # -> out; inputs key: Int32, keys: list of Int32, add_key: Boolean, remove_key: Boolean
# ---------- write: Python ----------
import os
from compas.rpc import Proxy

if connect:
    p = Proxy('xr_assembly.firebase.realtime_database')
    p.stop_server()
    p.start_server()

if remove_key:
    p.remove_key_built(key)

if add_key:
    p.add_key_built(key)

if set_keys:
    p.set_keys_built(keys)
# ---------- end write ----------
panel_3 = Panel(write)

# ----
# read from realtime database
connect_2 = BooleanToggle(False)
update_keys_built = Trigger(Interval=100, TimerInterval=100, Target=read)  # disabled
read = GhPythonScript(connect=connect_2)  # -> out, keys_built; inputs connect: Boolean
# ---------- read: Python ----------
import os
from compas.rpc import Proxy
    
 
if connect:
    p = Proxy('xr_assembly.firebase.realtime_database')
    
    p.stop_server()
    p.start_server()
    
    keys_built = p.get_keys_built()
    print(keys_built)
# ---------- end read ----------
panel_4 = Panel(read.keys_built)
panel_5 = Panel(read.out)

# ----
# export locally and upload to firebase storage
panel_6 = Panel("xrtest.json")
connect_3 = BooleanToggle(False)
upload = Button()
upload_2 = PythonScript(DATA=py, assembly=import, filename=panel_6, upload=upload, connect=connect_3)  # inputs connect: Boolean
# ---------- upload_2: Python ----------
import os
from compas.datastructures.mesh import mesh_quads_to_triangles
from compas.datastructures.mesh import mesh_unify_cycles
from compas.rpc import Proxy



print(filename)
path_on_cloud = str(filename)

if connect:
    p = Proxy('xr_assembly.firebase.storage')
    p.stop_server()
    p.start_server()

if upload:
    PATH = os.path.join(DATA, filename)
    
    path_on_cloud = filename
    path_local = PATH
    
    p.upload_to_firebase(path_on_cloud, path_local)
# ---------- end upload_2 ----------

# ----
# Targets
count = Slider(8, range=0..10)
show_6 = BooleanToggle(False)
qr_codes = GhPythonScript(count=count, show=show_6, export_to_unity=Button())  # -> out, markers, all_points, markers_origins, id; inputs count: Int32
# ---------- qr_codes: Python ----------
import rhinoscriptsyntax as rs
import Rhino.Geometry as rg

markers = []
id = []
markers_origins = []

circle = rs.AddCircle(rg.Point3d(0,0,0), 2.5)
all_points = rs.DivideCurve(circle, count)

if show:
    for i, point in enumerate(all_points):
    
       plane = rg.Plane(rg.Point3d(point[0], point[1], 0.0001), rg.Vector3d.ZAxis)
       T = rg.Transform.Translation(-0.1, -0.1, 0)
       marker_origin = rg.Point3d(point[0], point[1], 0.0001)
       marker_origin.Transform(T)
       markers_origins.append(marker_origin)
       
       marker = rg.Rectangle3d(plane, rg.Interval(-0.1, 0.1), rg.Interval(-0.1, 0.1))
       markers.append(marker)
       id.append(i)
# ---------- end qr_codes ----------
srf = Surface(qr_codes.markers)
pt_2 = Point(qr_codes.all_points)
pt_3 = Point(qr_codes.markers_origins)
pln_2 = Plane(qr_codes.markers_origins)
preview_9 = CustomPreview(Geometry=srf, Shader=ColourSwatch(SwatchColor=RGB(59, 59, 59)))
tag_2 = TextTag(Location=pt_2, Text=qr_codes.id)
