# Grasshopper definition 2ex_xr_assembly_firebase.ghx (Grasshopper 1.0.7)

bang = Button()
panel = Panel("Unload libraries")
unload = PythonScript(bang=bang)
# ---------- unload: Python ----------
from compas_rhino.utilities.misc import get_tolerance
from compas_rhino.utilities.misc import unload_modules

unload_modules("compas")
unload_modules("assembly_information_model")
unload_modules("xr_assembly")
# ---------- end unload ----------

# ----
# Import Assembly data from JSON
py = PythonScript()  # -> DATA
# ---------- py: Python ----------
import os
import getpass

username = getpass.getuser()
USER_FOLDER = os.path.abspath(os.path.join("C:/Users/", username))
DATA = os.path.abspath(os.path.join(USER_FOLDER,"workspace/projects/xr_assembly/data"))

print(username)
print(USER_FOLDER)
print(DATA)
# ---------- end py ----------
import = PythonScript(DATA=py, filename="xr_assembly.json", import_from_json=Toggle(True))  # -> assembly
# ---------- import: Python ----------
import os
from xr_assembly.assembly.assembly import XRAssembly


if import_from_json:
    #filename = "my_assembly.json"
    PATH = os.path.join(DATA, filename)
    assembly = XRAssembly.from_json(PATH)
# ---------- end import ----------

# ----
# Draw
idx = Slider(24, range=0..40)
# Firebase
show = BooleanToggle(False)
show_2 = BooleanToggle(True)
show_3 = BooleanToggle(False)
show_4 = BooleanToggle(True)
show_5 = BooleanToggle(True)
draw = PythonScript(
    assembly=import,
    show_all=show_3,
    show_network=show_4,
    show_built=show_2,
    show_buildable=show_5,
    idx_selected=idx,
    show_selected=show)  # -> G_elements_all, G_elements_structure, G_elements_support, G_nodes, G_edges, G_elements_built, G_elements_buildable, G_element_selected, planes, all_keys; inputs idx_selected: Int32, show_selected: Boolean
# ---------- draw: Python ----------
import os
import sys

import math
import rhinoscriptsyntax as rs
import Rhino.Geometry as rg
import ghpythonlib as gh

from compas.geometry import Vector
from compas_ghpython.artists import MeshArtist
from compas_ghpython.artists import NetworkArtist
from compas_ghpython import draw_frame

G_elements_all = []
G_elements_structure = []
G_elements_built = []
G_elements_buildable = []
G_element_selected = []
planes = []

print(assembly)

if show_all:
    for key, element in assembly.elements():
        artist = MeshArtist(element.mesh)
        mesh = artist.draw()
        G_elements_all.append(mesh)
        
    # elements which are part of the structure
    keys_support = list(assembly.network.nodes_where({'is_support':False}))
    for key in keys_support:
        element = assembly.element(key)
        artist = MeshArtist(element.mesh)
        mesh = artist.draw()
        G_elements_structure.append(mesh)
        planes.append(draw_frame(element.frame))

if show_network:
    G_nodes, G_edges = NetworkArtist(assembly.network).draw()

if show_built:
    keys = list(assembly.network.nodes_where({'is_built':True}))
    for key in keys:
        element = assembly.element(key)
        artist = MeshArtist(element.mesh)
        mesh = artist.draw()
        G_elements_built.append(mesh)

if show_buildable:
    keys = assembly.get_keys_buildable()
    for key in keys:
        element = assembly.element(key)
        artist = MeshArtist(element.mesh)
        mesh = artist.draw()
        G_elements_buildable.append(mesh)
        print assembly.element(key)

if show_selected:
    element = assembly.element(idx_selected)
    artist = MeshArtist(element.mesh)
    mesh = artist.draw()
    G_element_selected=mesh

all_keys = []

for key, element in assembly.elements():
    all_keys.append(key)
# ---------- end draw ----------
mesh = Mesh(draw.G_elements_all)
mesh_2 = Mesh(draw.G_elements_support)
pt = Point(draw.G_nodes)
mesh_3 = Mesh(draw.G_element_selected)
pln = Plane(draw.planes)
mesh_4 = Mesh(draw.G_elements_structure)
line = Line(draw.G_edges)
mesh_5 = Mesh(draw.G_elements_built)
mesh_6 = Mesh(draw.G_elements_buildable)
preview = CustomPreview(Geometry=mesh, Shader=ColourSwatch(SwatchColor=RGBA(209, 163, 163, 40)))
preview_2 = CustomPreview(Geometry=mesh_4, Shader=ColourSwatch(SwatchColor=RGBA(255, 156, 156, 111)))
preview_3 = CustomPreview(Geometry=mesh_2, Shader=ColourSwatch(SwatchColor=RGBA(156, 156, 156, 0)))
preview_4 = CustomPreview(Geometry=mesh_5, Shader=ColourSwatch(SwatchColor=RGB(209, 105, 105)))
preview_5 = CustomPreview(Geometry=mesh_6, Shader=ColourSwatch(SwatchColor=RGBA(168, 163, 209, 102)))
preview_6 = CustomPreview(Geometry=mesh_3, Shader=ColourSwatch(SwatchColor=RGB(255, 99, 99)))
preview_7 = CustomPreview(Geometry=pt, Shader=ColourSwatch(SwatchColor=RGB(0, 0, 0)))
preview_8 = CustomPreview(Geometry=line, Shader=ColourSwatch(SwatchColor=RGB(255, 122, 122)))
tag = TextTag(Location=draw.G_nodes, Text=draw.all_keys)

# ----
# write to realtime database
panel_2 = Panel("""5
10
12
13""")
key = Slider(5, range=0..100)
remove = Button()
connect = BooleanToggle(False)
add = Button()
set = Button()
write = GhPythonScript(key=key, keys=panel_2, set_keys=set, add_key=add, remove_key=remove, connect=connect)  # -> out; inputs key: Int32, keys: list of Int32, add_key: Boolean, remove_key: Boolean
# ---------- write: Python ----------
import os
from compas.rpc import Proxy

if connect:
    p = Proxy('xr_assembly.firebase.realtime_database')
    p.stop_server()
    p.start_server()

if remove_key:
    p.remove_key_built(key)

if add_key:
    p.add_key_built(key)

if set_keys:
    p.set_keys_built(keys)
# ---------- end write ----------
panel_3 = Panel(write)

# ----
# read from realtime database
connect_2 = BooleanToggle(False)
update_keys_built = Trigger(Interval=100, TimerInterval=100, Target=read)  # disabled
read = GhPythonScript(connect=connect_2)  # -> out, keys_built; inputs connect: Boolean
# ---------- read: Python ----------
import os
from compas.rpc import Proxy
    
 
if connect:
    p = Proxy('xr_assembly.firebase.realtime_database')
    
    p.stop_server()
    p.start_server()
    
    keys_built = p.get_keys_built()
    print(keys_built)
# ---------- end read ----------
panel_4 = Panel(read.keys_built)
panel_5 = Panel(read.out)

# ----
# upload .json to firebase storage
connect_3 = BooleanToggle(True)
upload = Button()
upload_2 = PythonScript(DATA=py, filename="xr_assembly.json", upload=upload, connect=connect_3)  # inputs connect: Boolean
# ---------- upload_2: Python ----------
import os
from compas.datastructures.mesh import mesh_quads_to_triangles
from compas.datastructures.mesh import mesh_unify_cycles
from compas.rpc import Proxy



print(filename)
path_on_cloud = str(filename)

if connect:
    p = Proxy('xr_assembly.firebase.storage')
    p.stop_server()
    p.start_server()

if upload:
    PATH = os.path.join(DATA, filename)
    
    path_on_cloud = filename
    path_local = PATH
    
    p.upload_to_firebase(path_on_cloud, path_local)
# ---------- end upload_2 ----------
